# Grasshopper definition ColorReader.gh (Grasshopper 1.0.7)

plane_size = Slider(64, range=0..100)
path = FilePath("E:\GitRepo\pix2pix_IF\Rhino_GH\V01\Testing\")
preview_size = Slider(0.5, range=0..1)
c_script = CSharpScript(planeSize=plane_size, folder=path)  # -> out, points; inputs planeSize: Int32, folder: String
# ---------- c_script: C# usings ----------
using System.Drawing;
using System.IO;
using System.Linq;
# ---------- c_script: C# ----------
    string[] imagesPaths = Directory.GetFiles(folder, "*.png");

    List<Point3d> generatedPoints = new List<Point3d>();
    for (int i = 0; i < imagesPaths.Length; i++)
    {
      string path = imagesPaths[i];
      Bitmap img = ResizeImage(new Bitmap(path), planeSize);

      for (int x = 0; x < img.Size.Width; x++)
      {
        for (int y = 0; y < img.Size.Height; y++)
        {
          var pix = img.GetPixel(x, y);
          bool r = pix.R < 60;
          bool g = pix.G < 60;
          bool b = pix.B < 60;
          if (r && g && b)
          {

            Point3d newPoint = new Point3d(x, planeSize - y, i);
            generatedPoints.Add(newPoint);
          }
        }
      }
    }
    points = generatedPoints;
# ---------- c_script: C# additional code ----------
  private Bitmap ResizeImage(Bitmap image, int size)
  {
    Rectangle destRect = new Rectangle(0, 0, size, size);
    Bitmap destImage = new Bitmap(size, size);
    destImage.SetResolution(image.HorizontalResolution, image.VerticalResolution);

    using (var graphics = Graphics.FromImage(destImage))
    {
      graphics.CompositingMode = System.Drawing.Drawing2D.CompositingMode.SourceCopy;
      graphics.CompositingQuality = System.Drawing.Drawing2D.CompositingQuality.AssumeLinear;
      graphics.InterpolationMode = System.Drawing.Drawing2D.InterpolationMode.NearestNeighbor;
      graphics.SmoothingMode = System.Drawing.Drawing2D.SmoothingMode.HighQuality;
      graphics.PixelOffsetMode = System.Drawing.Drawing2D.PixelOffsetMode.Half;

      graphics.DrawImage(image, destRect, 0, 0, image.Width, image.Height, GraphicsUnit.Pixel);
    }
    return destImage;
  }
# ---------- end c_script ----------
box = CenterBox(Base=c_script.points, X=preview_size, Y=preview_size, Z=preview_size)
Z = UnitZ(Factor=preview_size)
move = Move(Geometry=box, Motion=Z)  # -> Geometry, Transform
